# Grasshopper definition LinqGHExample.gh (Grasshopper 1.0.7)
# plug-ins: LinqGH

# ----
# Select
pop3d = Populate3D(Region={Plane=PlaneXY(0, 0, 0), X=Domain(0, 10), Y=Domain(0, 10), Z=Domain(0, 2)}, Count=100, Seed=1)
pt = Point(pop3d)
select = Select(pt, Expression="x => x.X")
select_2 = Select(pt, Expression="x => x")
select_textinput = Select_TextInput(List=pt, Lambda="x => x.X")
panel = Panel(select_2)
panel_2 = Panel(select)

# ----
# Where
pop3d_2 = Populate3D(Region={Plane=PlaneXY(0, 0, 0), X=Domain(0, 10), Y=Domain(0, 10), Z=Domain(0, 2)}, Count=100, Seed=1)
pt_2 = Point(pop3d_2)
where = Where(pt_2, Expression="x => x.X < 1")
where_textinput = Where_TextInput(List=pt_2, Lambda="x => x.X < 1")
panel_3 = Panel(where)
panel_4 = Panel(where_textinput)

# ----
# Single
pop3d_3 = Populate3D(Region={Plane=PlaneXY(0, 0, 0), X=Domain(0, 10), Y=Domain(0, 10), Z=Domain(0, 2)}, Count=100, Seed=1)
pt_3 = ConstructPoint(XCoordinate=0, YCoordinate=0, ZCoordinate=0)
pt_4 = Point(pop3d_3)
single = Single(pt_3)
single_2 = Single(pt_4)
single_textinput = Single_TextInput(List=pt_4)
single_textinput_2 = Single_TextInput(List=pt_3)
panel_5 = Panel(single_textinput_2)
panel_6 = Panel(single)
multiple_items_result_in_error = Panel(single_textinput)
multiple_items_result_in_error_2 = Panel(single_2)

panel_7 = Panel(select_textinput)

# ---- group: Last
pop3d_4 = Populate3D(Region={Plane=PlaneXY(0, 0, 0), X=Domain(0, 10), Y=Domain(0, 10), Z=Domain(0, 2)}, Count=100, Seed=1)
pt_5 = Point(pop3d_4)
last = Last(pt_5, Expression="x => x.X > 1")
last_2 = Last(pt_5)
last_textinput = Last_TextInput(List=pt_5, Lambda="x => x.X > 1")
last_textinput_2 = Last_TextInput(List=pt_5)
panel_8 = Panel(last)
panel_9 = Panel(last_textinput)
panel_10 = Panel(last_2)
panel_11 = Panel(last_textinput_2)

# ----
# SkipWhile
series = Series(Start=0, Step=1, Count=10)
panel_12 = Panel(series)
skipwhile = SkipWhile(series, Expression="x => x<5")
skipwhile_textinput = SkipWhile_TextInput(List=series, Lambda="x => x<5")
panel_13 = Panel(skipwhile)
panel_14 = Panel(skipwhile_textinput)

# ----
# TakeWhile
series_2 = Series(Start=0, Step=1, Count=10)
panel_15 = Panel(series_2)
takewhile = TakeWhile(series_2, Expression="x => x<5")
takewhile_textinput = TakeWhile_TextInput(List=series_2, Lambda="x => x<5")
panel_16 = Panel(takewhile)
panel_17 = Panel(takewhile_textinput)

# ---- group: First
# Distinct
series_3 = Series(Start=0, Step=1, Count=10)
merge = Merge(Data1=series_3, Data2=series_3)
panel_18 = Panel(merge)
distinct = Distinct(merge, Expression="x => x")
panel_19 = Panel(distinct)

# ----
# OrderBy
panel_20 = Panel("10")
random = Random(Range=Domain(0, 1), Number=panel_20, Seed=2)
pop3d_5 = Populate3D(Region={Plane=PlaneXY(0, 0, 0), X=Domain(0, 10), Y=Domain(0, 10), Z=Domain(0, 2)}, Count=100, Seed=1)
panel_21 = Panel(random)
pt_6 = Point(pop3d_5)
orderby = OrderBy(panel_21, Expression="x => x")
orderby_2 = OrderBy(pt_6, Expression="x => x.X")
orderby_textinput = OrderBy_TextInput(List=pt_6, Lambda="x => x.X")
panel_22 = Panel(orderby)
pline = PolyLine(Vertices=orderby_2, Closed=False)
pline_2 = PolyLine(Vertices=orderby_textinput, Closed=False)

# ----
# Min
panel_23 = Panel("10")
random_2 = Random(Range=Domain(0, 1), Number=panel_23, Seed=2)
panel_24 = Panel(random_2)
min = Min(random_2, Expression="x => x * x")
min_2 = Min(random_2)
min_textinput = Min_TextInput(List=random_2, Lambda="x => x * x")
min_textinput_2 = Min_TextInput(List=random_2)
panel_25 = Panel(min_textinput)
panel_26 = Panel(min_textinput_2)
panel_27 = Panel(min)
panel_28 = Panel(min_2)

# ----
# All
panel_29 = Panel("10")
random_3 = Random(Range=Domain(0, 1), Number=panel_29, Seed=2)
all = All(random_3, Expression="x => x < 0.5")
all_2 = All(random_3, Expression="x => x < 10")
all_textinput = All_TextInput(List=random_3, Lambda="x => x < 10")
all_textinput_2 = All_TextInput(List=random_3, Lambda="x => x < 0.5")
panel_30 = Panel(all_textinput_2)
panel_31 = Panel(all_textinput)
panel_32 = Panel(all)
panel_33 = Panel(all_2)

# ----
# Any
panel_34 = Panel("10")
random_4 = Random(Range=Domain(0, 1), Number=panel_34, Seed=2)
any = Any(random_4)
any_2 = Any(random_4, Expression="x => x < 0.5")
any_3 = Any(random_4, Expression="x => x < 10")
any_textinput = Any_TextInput(List=random_4, Lambda="x => x < 0.5")
any_textinput_2 = Any_TextInput(List=random_4, Lambda="x => x < 10")
any_textinput_3 = Any_TextInput(List=random_4)
panel_35 = Panel(any_textinput_2)
panel_36 = Panel(any_textinput)
returns_whether_the_list_contains_any_it = Panel(any_textinput_3)  # "Returns whether the list contains any items contained"
panel_37 = Panel(any_3)
panel_38 = Panel(any_2)
returns_whether_the_list_contains_any_it_2 = Panel(any)  # "Returns whether the list contains any items contained"

# ----
# Count
pop3d_6 = Populate3D(Region={Plane=PlaneXY(0, 0, 0), X=Domain(0, 10), Y=Domain(0, 10), Z=Domain(0, 2)}, Count=100, Seed=1)
pt_7 = Point(pop3d_6)

count = Count(pt_7, Expression="x => x.X < 1")
count_textinput = Count_TextInput(List=pt_7, Lambda="x => x.X < 1")

panel_39 = Panel(count)
panel_40 = Panel(count_textinput)

# ---- group: First
pop3d_7 = Populate3D(Region={Plane=PlaneXY(0, 0, 0), X=Domain(0, 10), Y=Domain(0, 10), Z=Domain(0, 2)}, Count=100, Seed=1)
pt_8 = Point(pop3d_7)
first = First(pt_8, Expression="x => x.X < 1")
first_textinput = First_TextInput(List=pt_8)
first_textinput_2 = First_TextInput(List=pt_8, Lambda="x => x.X < 1")
panel_41 = Panel(first)
panel_42 = Panel(first_textinput_2)
panel_43 = Panel(first_textinput)

# ----
first_2 = First(pt_8)

# ---- group: First (continued)
panel_44 = Panel(first_2)

# ----
# OrderByDescending
panel_45 = Panel("10")
random_5 = Random(Range=Domain(0, 1), Number=panel_45, Seed=2)
pop3d_8 = Populate3D(Region={Plane=PlaneXY(0, 0, 0), X=Domain(0, 10), Y=Domain(0, 10), Z=Domain(0, 2)}, Count=100, Seed=1)
panel_46 = Panel(random_5)
pt_9 = Point(pop3d_8)
orderbydescending = OrderByDescending(pt_9, Expression="x => x.X")
orderbydescending_textinput = OrderByDescending_TextInput(List=pt_9, Lambda="x => x.X")
pline_3 = PolyLine(Vertices=orderbydescending, Closed=False)
pline_4 = PolyLine(Vertices=orderbydescending_textinput, Closed=False)

orderbydescending_2 = OrderByDescending(panel_46, Expression="x => x")

panel_47 = Panel(orderbydescending_2)

# ----
# Min
panel_48 = Panel("10")
random_6 = Random(Range=Domain(0, 1), Number=panel_48, Seed=2)
panel_49 = Panel(random_6)
min_textinput_3 = Min_TextInput(List=random_6)
min_textinput_4 = Min_TextInput(List=random_6, Lambda="x => x * x")
panel_50 = Panel(min_textinput_3)
panel_51 = Panel(min_textinput_4)

max = Max(random_6, Expression="x => x * x")
max_2 = Max(random_6)

panel_52 = Panel(max)
panel_53 = Panel(max_2)
